# Requirement set export_Wiper_swreq (R2022b)

## 1 [Wiper_swreq] (Container)

### 1.1 [WMREQ001] Inputs/Outputs to the System

#### 1.1.1 [WMREQ001_1] Input_1 - Ignition

#### 1.1.2 [WMREQ001_2] Input_2 - Rain_Sensor

#### 1.1.3 [WMREQ001_3] Input_3 - Knob

#### 1.1.4 [WMREQ001_4] Output - Wiper_Output

### 1.2 [WMREQ002] Logical Connections inside systems

#### 1.2.1 [WMREQ002_1] Intermediate_1 = Rain_Sensor OR Knob

#### 1.2.2 [WMREQ002_2] Wiper = Intermediate_1 AND Ignition

#### 1.2.3 [WMREQ002_3] Compare to Constant (Equal to 1)

### 1.3 [WMREQ003] Wiper Enable behaviour
Wiper Output is only enabled when Ignition Switch is ON

#### 1.3.1 [WMREQ003_1] Wiper=ENABLE if Ignition=ON

### 1.4 [WMREQ004] Rain Sensor Activation
The Wiper Output shall turn ON if the Rain Sensor senses water droplets, only if the Ignition Switch is ON

#### 1.4.1 [WMREQ004_1] Wiper=ON if (Rain_Sensor=1 OR Knob=0) AND Ignition=1

### 1.5 [WMREQ005] Knob Activation
The Wiper Output shall turn ON if the Knob is manually turned ON, only if the Ignition Switch is ON

#### 1.5.1 [WMREQ005_1] Wiper=ON if (Rain_Sensor=0 OR Knob=1) AND Ignition=1

### 1.6 [WMREQ006] Rain Sensor and Knob Activation
The Wiper Output shall turn ON if both the Rain Sensor senses water droplets AND Knob is Turned ON with Ignition Switch ON

#### 1.6.1 [WMREQ006_1] Wiper=ON if (Rain_Sensor=1 OR Knob=1)AND Ignition=1

### 1.7 [WMREQ007] Wiper Disable Behavior1
Regardless of the inputs of Ignition Switch is ON, the wiper should be OFF if both the inputs of Rain Sensor and Knob to the Wiper, are OFF

#### 1.7.1 [WMREQ007_1] Wiper=ON if (Rain_Sensor=0 OR Knob=0)AND Ignition=1

### 1.8 [WMREQ008] Wiper Disable Behavior2
Regardless of the inputs of Rain Sensor and Knob to the Wiper, it should be OFF if the Ignition Switch is OFF

#### 1.8.1 [WMREQ008_1] Wiper=OFF if (Rain_Sensor=1 OR Knob=1)AND Ignition=0